# Grasshopper definition CarboCrocSampleProject.gh (Grasshopper 1.0.8)
# plug-ins: CarboCroc

# ---- group: GEOMETRY
# GEOMETRY CREATION
building_grid_xxy = Slider(7, range=0..50)
slab_thickness = Slider(0.292, range=0.1..1)
floor_height = Slider(3, range=0..5)
thickness = Slider(0.02, range=0..1)
width = Slider(0.24, range=0..1)
width_2 = Slider(0.24, range=0..1)
pt = ConstructPoint(XCoordinate=building_grid_xxy, YCoordinate=0, ZCoordinate=0)
pt_2 = ConstructPoint(XCoordinate=building_grid_xxy, YCoordinate=building_grid_xxy, ZCoordinate=0)
pt_3 = ConstructPoint(XCoordinate=0, YCoordinate=building_grid_xxy, ZCoordinate=0)
profile = CSharpScript(w=width, h=width_2, t=thickness)  # -> out, a; inputs w: Double, h: Double, t: Double
# ---------- profile: C# ----------
// Grasshopper Script Instance
#region Usings
using System;
using System.Linq;
using System.Collections;
using System.Collections.Generic;
using System.Drawing;

using Rhino;
using Rhino.Geometry;

using Grasshopper;
using Grasshopper.Kernel;
using Grasshopper.Kernel.Data;
using Grasshopper.Kernel.Types;
#endregion

public class Script_Instance : GH_ScriptInstance
{
    #region Notes
    /* 
      Members:
        RhinoDoc RhinoDocument
        GH_Document GrasshopperDocument
        IGH_Component Component
        int Iteration

      Methods (Virtual & overridable):
        Print(string text)
        Print(string format, params object[] args)
        Reflect(object obj)
        Reflect(object obj, string method_name)
    */
    #endregion

    private void RunScript(double w, double h, double t, ref object a)
    {
        List<Point3d> result = new List<Point3d>();
        // Write your logic here
        Point3d pnt0 = new Point3d(0,h/2,0);
        Point3d pnt1 = new Point3d(w/2,h/2,0);
        Point3d pnt2 = new Point3d(w/2,h/2 - t,0);
        Point3d pnt3 = new Point3d(t/2,h/2 - t, 0);
        Point3d pnt4 = new Point3d(t/2,-h/2 + t,0);
        Point3d pnt5 = new Point3d(w/2,-h/2 + t,0);
        Point3d pnt6 = new Point3d(w/2,-h/2,0);
        Point3d pnt7 = new Point3d(0,-h/2,0);

result.Add(pnt0);
result.Add(pnt1);
result.Add(pnt2);
result.Add(pnt3);
result.Add(pnt4);
result.Add(pnt5);
result.Add(pnt6);
result.Add(pnt7);

        a = result;
    }
}
# ---------- end profile ----------
pt_4 = ConstructPoint(XCoordinate=0, YCoordinate=0, ZCoordinate=0)
num = Number(building_grid_xxy)
vec = VectorXYZ(XComponent=0, YComponent=0, ZComponent=floor_height)  # -> Vector, Length
pline = PolyLine(Vertices=profile.a, Closed=Toggle(False))
pline_2 = PolyLine(Vertices=[pt_4, pt, pt_2, pt_3], Closed=True)
mirror = Mirror(Geometry=pline, Plane=PlaneYZ(0, 0, 0))  # -> Geometry, Transform
vec_2 = VectorXYZ(XComponent=0, YComponent=0, ZComponent=slab_thickness)  # -> Vector, Length
srf = Surface(pline_2)
join = JoinCurves(Curves=[pline, mirror.Geometry], Preserve=False)
area = Area(Geometry=srf)  # -> Area, Centroid
scale = Scale(Geometry=srf, Center=area.Centroid, Factor=Slider(1.1, range=0..10))  # -> Geometry, Transform
multiplication = Multiplication(A=slab_thickness, B="1000")
extr = Extrude(Base=scale.Geometry, Direction=vec_2.Vector)
srf_2 = Surface(join)
num_2 = Number(num)
extr_2 = Extrude(Base=srf_2, Direction=vec.Vector)
move = Move(Geometry=extr, Motion=vec.Vector)  # -> Geometry, Transform
vec_3 = VectorXYZ(XComponent=0, YComponent=0, ZComponent=floor_height)  # -> Vector, Length
vec_4 = VectorXYZ(XComponent=num_2, YComponent=0, ZComponent=0)  # -> Vector, Length
vec_5 = VectorXYZ(XComponent=num_2, YComponent=num_2, ZComponent=0)  # -> Vector, Length
vec_6 = VectorXYZ(XComponent=0, YComponent=num_2, ZComponent=0)  # -> Vector, Length
join_2 = TextJoin(Text=[multiplication, " THK RC SLAB"])
move_2 = Move(Geometry=extr_2, Motion=[vec_4.Vector, vec_5.Vector, vec_6.Vector])  # -> Geometry, Transform
panel = Panel(join_2)
geo = Geometry(move.Geometry)
geo_2 = Geometry([move_2.Geometry, extr_2])
move_3 = Move(Geometry=geo_2, Motion=vec_3.Vector)  # -> Geometry, Transform
move_4 = Move(Geometry=geo, Motion=vec_3.Vector)  # -> Geometry, Transform
geo_3 = Geometry(extr)
geo_4 = Geometry([move_3.Geometry, geo_2])
volume = Volume(Geometry=geo_4)  # -> Volume, Centroid

# ----
# VISUALISATION
number_slider = Slider(199, range=0..1000)
number_slider_2 = Slider(114, range=0..1000)
rgb = ColourRGB(Alpha=255, Red=Slider(694, range=0..1000), Green=number_slider_2, Blue=number_slider_2)
rgb_2 = ColourRGB(Alpha=255, Red=number_slider, Green=number_slider, Blue=number_slider)
material = CreateMaterial(Diffuse=rgb, Specular=RGB(255, 255, 255), Emission=RGB(0, 0, 0), Transparency=0, Shine=0)
material_2 = CreateMaterial(Diffuse=rgb_2, Specular=RGB(255, 255, 255), Emission=RGB(0, 0, 0), Transparency=0, Shine=0)
preview = CustomPreview(Geometry=[move_3.Geometry, geo_2], Material=material)
preview_2 = CustomPreview(Geometry=[move_4.Geometry, geo, geo_3], Material=material_2)

# ---- group: GEOMETRY / Top Slabs
geo_5 = Geometry([geo, move_4.Geometry])
volume_2 = Volume(Geometry=geo_5)  # -> Volume, Centroid

# ----
# CARBOCROC
# TEMPLATE SELECT
# The Below will Set a GLOBAL project template that all nodes have access to.
carbocroctemplateselector = CarboCrocTemplateSelector(SelectedIndex=0)  # -> TemplatePath, TemplateName
panel_2 = Panel(carbocroctemplateselector.TemplatePath)
panel_3 = Panel(carbocroctemplateselector.TemplateName)
set = Button()
carbocroctemplatesetter = CarboCrocTemplateSetter(Path=panel_2, Set=set)  # -> Message, TemplatePath
panel_4 = Panel(carbocroctemplatesetter.TemplatePath)
panel_5 = Panel(carbocroctemplatesetter.Message)

# ---- group: Settings
# CARBOCROC
# PROJECT SWITCHES
# These switches control which project phases A1-D will be colculated
# as a default the embodied carbon will be calculated (A1-A3 + C1-C4)
# The uncertainty factor will increase all element's
#  calculated carbon by it's given value. 0-1 (0-100%)
# The uncertainty factor will increase all element's
#  calculated carbon by it's given value. 0-1 (0-100%)
number_slider_3 = Slider(0.1, range=0..1)
panel_6 = Panel("320")
boolean_toggle = BooleanToggle(True)  # "A1-A3"
a4 = BooleanToggle(True)
a5 = BooleanToggle(True)
boolean_toggle_2 = BooleanToggle(True)  # "B1-B6"
boolean_toggle_3 = BooleanToggle(True)  # "C1-C4"
D = BooleanToggle(False)
sequestration = BooleanToggle(True)
additional = BooleanToggle(True)
carbo_life_switches = CarboLifeSwitches(
    A1A3=boolean_toggle,
    A4=a4,
    A5=a5,
    B1B6=boolean_toggle_2,
    C1C4=boolean_toggle_3,
    D=D,
    Seq=sequestration,
    Extra=additional)  # -> Message, CarboSwitches
panel_7 = Panel(carbo_life_switches.Message)

# ---- group: CarboCalc
# CARBOCROC
# CALCULATION
# Start with a List of your global or default template
# Select a material using the index from a list.
# Define elements
# Define elements
# Using geometry
# Wrap all elements in a solver
# to calculate your project
list_all_materials = ListMaterials()
panel_8 = Panel(list_all_materials)
selector = Slider(47, range=0..100)
geo_6 = Geometry(geo_3)
geo_7 = Geometry([move_3.Geometry, geo_2])
selector_2 = Slider(113, range=0..200)
c_script = CSharpScript(geo=geo_7)  # -> out, guid
# ---------- c_script: C# ----------
// Grasshopper Script Instance
#region Usings
using System;
using System.Linq;
using System.Collections;
using System.Collections.Generic;
using System.Drawing;

using Rhino;
using Rhino.Geometry;

using Grasshopper;
using Grasshopper.Kernel;
using Grasshopper.Kernel.Data;
using Grasshopper.Kernel.Types;
#endregion

public class Script_Instance : GH_ScriptInstance
{
    #region Notes
    /* 
      Members:
        RhinoDoc RhinoDocument
        GH_Document GrasshopperDocument
        IGH_Component Component
        int Iteration

      Methods (Virtual & overridable):
        Print(string text)
        Print(string format, params object[] args)
        Reflect(object obj)
        Reflect(object obj, string method_name)
    */
    #endregion

    private void RunScript(object geo, ref object guid)
    {
        Guid newGuid = Guid.NewGuid();

        // Write your logic here
        guid = newGuid;
    }
}
# ---------- end c_script ----------
concrete = ListItem(List=list_all_materials, Index=selector, Wrap=True)
concrete_2 = ListItem(List=list_all_materials, Index=selector_2, Wrap=True)
panel_9 = Panel(panel)
panel_10 = Panel(concrete)
panel_11 = Panel(concrete_2)
c_script_2 = CSharpScript(GEO=geo_5)  # -> out, guid
# ---------- c_script_2: C# ----------
// Grasshopper Script Instance
#region Usings
using System;
using System.Linq;
using System.Collections;
using System.Collections.Generic;
using System.Drawing;

using Rhino;
using Rhino.Geometry;

using Grasshopper;
using Grasshopper.Kernel;
using Grasshopper.Kernel.Data;
using Grasshopper.Kernel.Types;
#endregion

public class Script_Instance : GH_ScriptInstance
{
    #region Notes
    /* 
      Members:
        RhinoDoc RhinoDocument
        GH_Document GrasshopperDocument
        IGH_Component Component
        int Iteration

      Methods (Virtual & overridable):
        Print(string text)
        Print(string format, params object[] args)
        Reflect(object obj)
        Reflect(object obj, string method_name)
    */
    #endregion

    private void RunScript(object GEO, ref object guid)
    {
        Guid newGuid = Guid.NewGuid();

        // Write your logic here
        guid = newGuid;
    }
}
# ---------- end c_script_2 ----------
id = Guid(c_script.guid)
carbocrocgeoelement = CarboCrocGeoElement(Id="125", ElementName=panel, MaterialName=panel_10, BREP=geo_6, Category="Floor")  # -> flatten(CarboElement), Message
carbocrocelement = CarboCrocElement(Id="1111", ElementName=panel_9, MaterialName=panel_10, Volume=volume_2.Volume, Category="Floor", GUID=c_script_2.guid)  # -> flatten(CarboElement), Message
carbocrocelement_2 = CarboCrocElement(
    Id="1111",
    ElementName="Steel Column",
    MaterialName=panel_11,
    Volume=volume.Volume,
    Category="Structural Columns",
    GUID=id)  # -> flatten(CarboElement), Message
panel_12 = Panel(carbocrocelement.CarboElement)
carbo_life_project_solver_by_elements = ProjectElementSolver(
    CarboElements=[carbocrocelement.CarboElement, carbocrocgeoelement.CarboElement, carbocrocelement_2.CarboElement],
    Switches=carbo_life_switches.CarboSwitches,
    Uncertainty=number_slider_3,
    GIA=panel_6)  # -> Total, CarboProject, Message, TXT

# ----
# CARBOCROC
# RESULTS
panel_13 = Panel(carbo_life_project_solver_by_elements.TXT)
panel_14 = Panel(carbo_life_project_solver_by_elements.Message)
panel_15 = Panel(carbo_life_project_solver_by_elements.Total)
split = TextSplit(Text=panel_14, Separators=";")  # -> simplify(Result)
panel_16 = Panel(split)
int = Integer(1)
item = ListItem(List=panel_16, Index=int, Wrap=True)
flatten = FlattenTree(Tree=item, Path="{0}")
panel_17 = Panel(flatten)
normalise = CSharpScript(x=panel_17)  # -> out, A; inputs x: list of Double
# ---------- normalise: C# ----------
    List<double> result = new List<double>();

    foreach(double nr in x)
    {
      if(nr < 0)
      {
        result.Add(Math.Round(nr * -1,1));
      }

      if(nr > 0)
      {
        result.Add(Math.Round(nr,1));
      }

    }
    A = result;
# ---------- end normalise ----------
panel_18 = Panel(normalise.A)
repeat = RepeatData(Data=graft(normalise.A), Length=graft(normalise.A))  # -> flatten(Data)
pie = PieChart(repeat)

# ---- group: Save Project
# CARBOCROC
# SAVE FILE
# Save the project next to the grasshopper file, or set a custom path and name
edit_path = Panel("C:\Temp\RhinoSave.clcx")
save_project = SaveACarboLifeProject(Project=carbo_life_project_solver_by_elements.CarboProject, Save=Toggle(True))
panel_19 = Panel(save_project)
